# Grasshopper definition voronoi_definition.gh (Grasshopper 0.9.76)

xz = XZPlane(Origin=Point(0, 0, 0))
md_slider = MDSlider(
    slider_value=Point(0.6737432065, 0.6615439967, 0.5),
    SliderMode=0,
    x_domain=Domain(0, 1),
    y_domain=Domain(0, 1),
    z_domain=Domain(0, 1))
rectangle = Rectangle(Plane=xz, XSize=Slider(100, range=0..100), YSize=Slider(80, range=0..100), Radius=0)  # -> Rectangle, Length
boundary = BoundarySurfaces(Edges=rectangle.Rectangle)
evalsrf = EvaluateSurface(Surface=reparameterize(boundary), Point=md_slider)  # -> Point, Normal, Frame
pop2d = Populate2D(Region=rectangle.Rectangle, Count=Slider(100, range=0..100), Seed=Slider(50, range=0..100))
cp = ClosestPoint(Point=pop2d, Cloud=evalsrf.Point)  # -> ClosestPoint, CPIndex, Distance
voronoi = Voronoi(Points=pop2d, BruteForceOverride=False)
bnd = Bounds(Numbers=cp.Distance)
dom = ConstructDomain(DomainStart=Slider(0.7, range=0..1), DomainEnd=Slider(0.4, range=0..1))
rint = RegionIntersection(CurvesA=voronoi, CurvesB=rectangle.Rectangle)
remap = RemapNumbers(Value=cp.Distance, Source=bnd, Target=dom)  # -> Mapped, Clipped
scale = Scale(Geometry=rint, Center=pop2d, Factor=remap.Mapped)  # -> Geometry, Transform
